# Grasshopper definition model.gh (Grasshopper 1.0.7)
# plug-ins: Speckle 2

brep = Brep([<brep referenced from the Rhino model> x5])
cluster = Cluster(geometry=brep)  # -> mesh_3, area_3, point_2
roompts = Point(cluster.point_2)
mesh = Mesh(cluster.mesh_3)
pdecon = Deconstruct(Point=roompts)  # -> XComponent, YComponent, ZComponent
cset = CreateSet(List=pdecon.ZComponent)  # -> Set, Map
data = Data(cluster.area_3)
data_2 = Data(cluster.point_2)
id = Guid(brep)
level = Level(
    Name="Level 0",
    Elevation=Slider(0, range=0..1),
    SelectedConstructorName="Objects.BuiltElements.Level.ctor(System.String,System.Double)",
    SelectedTypeName="Objects.BuiltElements.Level",
    UseSchemaTag=False,
    UserSetSchemaTag=False,
    seed="ee64e9ea70aa5e2ea481")
area = Area(Geometry=brep)  # -> Area, Centroid
txt = Text(id)
panel = Panel("https://app.speckle.systems/projects/09c17a606e/models/c205848608")
room = Room(
    Name=txt,
    Number=txt,
    Level=level,
    BasePoint=area.Centroid,
    SelectedConstructorName="Objects.BuiltElements.Room.ctor(System.String,System.String,Objects.BuiltElements.Level,Objects.Geometry.Point)",
    SelectedTypeName="Objects.BuiltElements.Room",
    UseSchemaTag=False,
    UserSetSchemaTag=False,
    seed="4abfda0abb5bd43ff3cd")
send = Send(
    Stream=panel,
    Data=room,
    AutoSend=False,
    BaseId="29cbfe11e068518889d088d9d7496c88",
    CurrentComponentState="expired",
    KitName="Objects",
    OutputWrappers="https://app.speckle.systems\t09c17a606e\t82058c9bcb",
    UseDefaultCache=True,
    selectedKitName="Objects")

# ==== cluster Cluster
geometry = ClusterInput()

# ---- group: Boundary Volume
geometry_2 = Mesh(geometry)

# ----
Z = UnitZ(Factor=1)
facen = FaceNormals(Mesh=geometry_2)  # -> Centers, Normals
rev = Reverse(Vector=Z)
dprod = DotProduct(VectorA=rev, VectorB=facen.Normals, Unitize=False)
equals = Equality(FirstNumber=dprod, SecondNumber=Slider(1, range=0..100))  # -> Equality, Inequality
cullf = CullFaces(Mesh=geometry_2, Pattern=equals.Inequality)
mjoin = MeshJoin(Meshes=cullf)
mesh = Mesh(cullf)
facen_2 = FaceNormals(Mesh=mesh)  # -> Centers, Normals
flatten = FlattenTree(Tree=mjoin, Path="{0}")
area = Area(Geometry=mesh)  # -> Area, Centroid
mesh_2 = Mesh(flatten)
area_2 = Number(area.Area)
point = Point(area.Centroid)
area_3 = ClusterOutput(area_2)
point_2 = ClusterOutput(point)
mesh_3 = ClusterOutput(mesh_2)
